# Grasshopper definition K-means v0-3.gh (Grasshopper 0.9.76)

number_slider = Slider(2, range=0..100)
pt = Point(Point(14, -16, 10))
pt_2 = Point(Point(16, 15, -10))
pt_3 = Point(Point(-30, -28, -10))
pt_4 = Point(Point(-8, 11, 10))
pt_5 = Point(Point(-4, -15, 0))
pt_6 = Point("20,20,20")
pt_7 = Point("-20,20,-20")
pt_8 = Point("-20,-20,-20")
cluster = Cluster_3(scale=number_slider, ptcount=Slider(21, range=1..50), seed=Slider(2, range=2..12), ptcenter=pt)
cluster_2 = Cluster_3(scale=number_slider, ptcount=Slider(22, range=1..50), seed=Slider(3, range=2..12), ptcenter=pt_2)
cluster_3 = Cluster_3(scale=number_slider, ptcount=Slider(23, range=1..50), seed=Slider(5, range=2..12), ptcenter=pt_3)
cluster_4 = Cluster_3(scale=number_slider, ptcount=Slider(25, range=1..50), seed=Slider(8, range=2..12), ptcenter=pt_5)
cluster_5 = Cluster_3(scale=number_slider, ptcount=Slider(24, range=1..50), seed=Slider(7, range=2..12), ptcenter=pt_4)
cluster_6 = Cluster_3(scale=number_slider, ptcount=Slider(26, range=1..50), seed=Slider(9, range=2..12), ptcenter=pt_6)
cluster_7 = Cluster_3(scale=number_slider, ptcount=Slider(27, range=1..50), seed=Slider(11, range=2..12), ptcenter=pt_7)
cluster_8 = Cluster_3(scale=number_slider, ptcount=Slider(28, range=1..50), seed=Slider(12, range=2..12), ptcenter=pt_8)
merge = Merge(
    Data1=cluster,
    Data2=cluster_2,
    Data3=cluster_3,
    Data4=cluster_5,
    Data5=cluster_4,
    Data6=cluster_6,
    Data7=cluster_7,
    Data8=cluster_8)
pt_9 = Point([Point(32, 27, 0), Point(35, 34, 0), Point(28, 39, 0), Point(27, 36, 0), Point(25, 31, 0), Point(23, 28, 0), Point(16, 33, 0), Point(11, 33, 0), Point(30, 24, 0), Point(35, 29, 0)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])
pt_10 = Point([Point(-33, 30, 0), Point(22, 22, 0), Point(20, -21, 0), Point(-22, -7, 0), Point(-45, -40, 0), Point(26, -33, 0)])
pt_11 = Point(Point(0, 0, 0))
pt_12 = Point([Point(39, 28, 0), Point(35, 34, 0), Point(31, 36, 0), Point(33, 28, 0), Point(32, 45, 0), Point(18, 41, 0)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])
pt_13 = Point([Point(-32, 31, 0), Point(-25, 17, 0), Point(-19, 30, 0), Point(-26, 23, 0), Point(-33, 20, 0), Point(-33, 30, 0)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])
rndz = RndZ(pt=pt_10)
rndz_2 = RndZ(pt=[pt_12, pt_13])
p_pts = Point(merge)
c_pts = Point(rndz)
lng = ListLength(List=c_pts)
series = Series(Start=Slider(1, range=0..100), Step=1, Count=Slider(10, range=1..14))
data = Data(graft(series))
addition = Addition(A=lng, B=data)
cluster_9 = Cluster(C=addition)
lng_2 = ListLength(List=series)
vb = VBScript(P=p_pts, C=c_pts, K=data, S=Slider(3, range=1..10), seed=Slider(2, range=1..3))  # -> out, P_out, K_centers, P_K_index, Mean_Dist; inputs P: list, C: list
# ---------- vb: VB ----------
    'P input conversion and errorcheck
    Dim arrP(P.count - 1, 0)
    Dim errorP = True
    For i As Integer = 0 To P.count - 1
      Dim templist()
      templist = (Split(P.item(i), ","))
      For j As Integer = 0 To templist.count - 1
        If j > UBound(arrP, 2) Then
          ReDim Preserve arrP(UBound(arrP, 1), j)
        End If
        arrP(i, j) = templist(j)
        If Not IsNumeric(arrP(i, j)) Then
          errorP = False
        End If
      Next
    Next
    If Not errorP Then
      Print("Input P does not consist of numbers separated by comma's")
      Exit Sub
    End If

    'C input conversion and errorcheck
    Dim arrC(C.count - 1, 0)
    Dim errorC = True
    For i As Integer = 0 To C.count - 1
      Dim templist()
      templist = (Split(C.item(i), ","))
      For j As Integer = 0 To templist.count - 1
        If j > UBound(arrC, 2) Then
          ReDim Preserve arrC(UBound(arrC, 1), j)
        End If
        arrC(i, j) = templist(j)
        If Not IsNumeric(arrC(i, j)) Then
          errorC = False
        End If
      Next
    Next
    If Not errorC Then
      Print("Input C does not consist of numbers separated by comma's")
      Exit Sub
    End If

    'Dimensionality Check'
    Dim dimensions(0) As Integer
    Dim dimension As Integer
    Dim dimsame = True
    Dim dcheck As New List(Of Object)(P)
    dcheck.AddRange(C)
    For i As Integer = 0 To dcheck.Count - 1
      Dim templist()
      templist = Split(dcheck.Item(i), ",")
      ReDim Preserve dimensions(i)
      dimensions(i) = CInt(templist.count)
    Next
    For i As Integer = 1 To UBound(dimensions)
      If dimensions(i - 1) <> dimensions(i) Then
        dimsame = False
        Exit For
      End If
    Next
    If dimsame = False Then
      Print("Error, inputs have unequal number Of dimensions.")
      Exit Sub
    Else
      dimension = dimensions(UBound(dimensions))
      Print("The datapionts all have " & dimension & " dimensions.")
    End If

    'Test whether there are enough points to perform clustering
    If Not P.count >= C.count + K Then
      Print("There are too few points or too many clusters to perform clustering")
      Exit Sub
    End If

    'Check whether and where C occurs in P
    Dim indCinP As New List (Of Integer)
    For i As Integer = 0 To C.count - 1
      For j As Integer = 0 To P.count - 1
        If InStr(P(j), C(i)) <> 0 Then
          indCinP.Add(j)
        End If
      Next
    Next

    'Main variables
    Dim datapoints(P.count, dimension) As Double
    Dim coordlist() As String
    Dim clusterpoints(C.count, dimension) As Double

    'Reformat inputs
    For i As Integer = 0 To P.Count - 1
      coordlist = Split(P(i), ",")
      For j As Integer = 0 To coordlist.Count - 1
        datapoints(i, j) = CDbl(coordlist(j))
      Next
    Next

    For i As Integer = 0 To C.Count - 1
      coordlist = Split(C(i), ",")
      For j As Integer = 0 To coordlist.Count - 1
        clusterpoints(i, j) = CDbl(coordlist(j))
      Next
    Next

    'Determine points elligeble for initial cluster centers.
    Dim arrIniPts((P.count - indCinP.count - 1), dimension - 1)
    Dim indOffset = 0
    For i As Integer = 0 To P.count - 1
      If Not indCinP.Contains(i) Then
        For j As Integer = 0 To dimension - 1
          arrIniPts(i - indOffset, j) = arrP(i, j)
        Next
      Else
        indOffset += 1
      End If
    Next

    'Create randomized initiation indexes
    Dim seeduse As Integer = 0
    Rnd(-1)
    Randomize(seed)
    Dim indIniMax As Integer = UBound(arrIniPts, 1)
    Dim arrIniInd(S - 1, K - 1)
    Dim randIniInd As New Hashset(Of Integer)
    For h As Integer = 0 To S - 1
      While randIniInd.count < K
        randIniInd.Add((indIniMax) * Rnd())
      End While
      If randIniInd.count = K Then
        randIniInd.ToList
        For i As Integer = 0 To K - 1
          arrIniInd(h, i) = randIniInd(i)
        Next
        randIniInd.clear
      End If
    Next

    Dim minMeanDist As Double = 0
    Dim arrKBest(C.count + K - 1,(dimension - 1))
    Dim arrAtrBest(UBound(arrP,1)) As Integer
    'ALGORITHM INI------------------------------------------------------------
    'sample iterations
    For h As Integer = 0 To S - 1

      'Create initial centerlist
      Dim arrK (C.count + K - 1,(dimension - 1))
      For i As Integer = 0 To K - 1
        For j As Integer = 0 To dimension - 1
          arrK(i, j) = arrP(arrIniInd(h, i), j).clone
        Next
      Next
      For i As Integer = K To C.count + K - 1
        For j As Integer = 0 To dimension - 1
          arrK(i, j) = arrC(i - K, j).clone
        Next
      Next

      Dim iteration As Integer = 0
      Dim maxIteration As Integer = 180
      Dim terminate = False
      'ALGORITHM ITERATIONS----------------------------------------------------
      Do While iteration < maxIteration And Not terminate

        'Reference clusterpoints for termination
        Dim arrKRef(C.count + K - 1,(dimension - 1))
        arrKRef = arrK.clone

        'Determine which cluster is closest to each point
        Dim shrtDist As Double
        Dim arrAtr(UBound(arrP,1)) As Integer
        Dim arrPDist(UBound(arrP,1)) As Double
        Dim arrKDist(UBound(arrK,1)) As Double
        Dim arrKCount(UBound(arrK,1)) As Integer
        For i As Integer = 0 To UBound(arrP, 1)
          For l As Integer = 0 To UBound(arrK, 1)
            If l = 0 Or NDimDist(arrP, arrK, i, l) < shrtDist Then
              shrtDist = NDimDist(arrP, arrK, i, l)
              arrAtr(i) = l
              arrPDist(i) = shrtDist
            End If
          Next
        Next

        'Determine clustercount and distance
        For i As Integer = 0 To UBound(arrP, 1)
          For l As Integer = 0 To UBound(arrK, 1)
            If arrAtr(i) = l Then
              arrKCount(l) += 1
              arrKDist(l) += arrPDist(i)
            End If
          Next
        Next

        'Calculate meanDist
        Dim meanDist As Double = 0
        For l As Integer = 0 To UBound(arrK, 1)
          meanDist += arrKDist(l)
        Next
        meanDist = meanDist / UBound(arrP, 1)



        'Determine average point of each luster
        Dim currentId As Integer = 0
        Dim newPtK(UBound(arrK, 1),UBound(arrK, 2))
        For l As Integer = 0 To UBound(arrK, 1)
          Dim arrPtsK(arrKCount(l),dimension -1)
          For i As Integer = 0 To arrAtr.count - 1
            If arrAtr(i) = l Then
              For j As Integer = 0 To dimension - 1
                arrPtsK(currentId, j) = arrP(i, j).clone
              Next
              currentId += 1
            End If
          Next
          If arrKCount(l) > 0 And l <= K Then
            For j As Integer = 0 To dimension - 1
              arrK(l, j) = NDimMean(arrPtsK)(j)
            Next
          End If
          currentId = 0
        Next


        'Test Convergence
        Dim kDist As Double = 0
        For l As Integer = 0 To UBound(arrK, 1)
          kDist += NDimDist(arrK, arrKRef, l, l)
        Next
        If kDist > 0 Then
          'Print("Still changing, keep going. kDist: " & kDist)
        ElseIf kDist = 0 Then
          Print("Converged, stop iterating. meanDist: " & meanDist)
          terminate = True
        Else
          Print("kDist < 0, this should not happen")
        End If

        iteration += 1
        'STORE CURRENT BEST SOLUTION
        If h = 0 Or meanDist < minMeanDist
          minMeanDist = meanDist
          arrKBest = arrK.Clone
          arrAtrBest = arrAtr.Clone
        End If
      Loop
      'END OF ITERATIONS--------------------------------------------------------


    Next
    'END OF SAMPLES-----------------------------------------------------------

    'Create Kcenter output treeK
    Dim kList As New List (Of String)
    Dim treeK As New List (Of String) '(UBound(arrKBest, 1))
    For i As Integer = 0 To UBound(arrKBest, 1)
      For j As Integer = 0 To UBound(arrKBest, 2)
        kList.add(arrKBest(i, j))
      Next
      treeK.Add(String.Join(",", kList))
      kList.clear

    Next

    'Put points into branches
    Dim treeP As New List (Of String)
    For l As Integer = 0 To UBound(arrKBest, 1)
      'Dim pth As New GH_Path(l)
      For i As Integer = 0 To P.count - 1
        If l = arrAtrBest(i) Then
          treeP.add(p(i))
        End If
      Next
    Next

    'Store attribution indexes
    Dim treeAtr As New List (Of Integer)
    For i As Integer = 0 To P.count - 1
      treeAtr.Add(arrAtrBest(i))
    Next


    'Outputs
    P_out = treeP
    K_centers = treeK
    P_K_index = treeAtr
    Mean_Dist = minMeanDist
# ---------- vb: VB additional code ----------
  Function NDimDist(ByRef Pt1(,), ByRef Pt2(,), i, l)
    Dim distSqrt As Double = 0, dist As Double = 0
    For j As Integer = 0 To UBound(Pt1, 2)
      distSqrt = distSqrt + ((Pt1(i, j) - Pt2(l, j)) ^ 2)
    Next
    dist = distSqrt 'Math.Sqrt(distSqrt)
    Return dist
    distSqrt = 0
    dist = 0
  End Function

  Function NDimMean(ByRef Pts(,))
    Dim jDimMean As Double = 0, ptMean(UBound(Pts, 2)) As Double
    For j As Integer = 0 To UBound(Pts, 2)
      For i As Integer = 0 To UBound(Pts, 1)
        jDimMean = jDimMean + Pts(i, j)
      Next
      ptMean(j) = jDimMean / (UBound(Pts, 1))
      jDimMean = 0
    Next
    Return ptMean
  End Function
# ---------- end vb ----------
gradient = Gradient(
    LowerLimit=0,
    UpperLimit=1,
    Parameter=cluster_9,
    stops=[0: RGB(243, 57, 0), 0.115: RGB(236, 27, 60), 0.219: RGB(210, 0, 118), 0.328: RGB(103, 0, 120), 0.444: RGB(39, 72, 161), 0.549: RGB(1, 192, 229), 0.68: RGB(18, 178, 90), 0.788: RGB(79, 186, 8), 0.895: RGB(220, 237, 32), 1: RGB(247, 159, 20)])
graph = QuickGraph(flatten(vb.Mean_Dist))
cluster_10 = Cluster_4(p_k_index=vb.P_K_index, p_out=vb.P_out)
range = Range(Domain=Domain(-4, 4), Steps=lng_2)
Z = UnitZ(Factor=range)  # -> simplify(UnitVector)
simplify = SimplifyTree(Tree=gradient, Front=False)
cluster_11 = Cluster_2(D=graft(Z), T=gradient)
move = Move(Geometry=cluster_10, Motion=cluster_11)  # -> Geometry, Transform
graft = GraftTree(Tree=simplify, IncludeEmptyLists=True, IncludeNullItems=True)
split = SplitTree(Data=move.Geometry, Masks=flatten("{6;?}"))  # -> Positive, Negative
split_2 = SplitTree(Data=graft, Masks=flatten("{6;?}"))  # -> Positive, Negative
dots = DotDisplay(Point=split.Positive, Colour=simplify(graft(split_2.Positive)), Size=2)

# ==== cluster RndZ
pt = ClusterInput()
pt_2 = Point(pt)
lng = ListLength(List=pt_2)
random = Random(Range=Domain(0, 100), Number=lng, Seed=2)
down = Down(G=pt_2)
Z = UnitZ(Factor=random)
move = Move(Geometry=down, Motion=Z)  # -> Geometry, Transform
G = ClusterOutput(move.Geometry)

# ==== cluster Cluster
C = ClusterInput()
div = DivideDomain(Domain=Domain(0, 1), Count=C)
dedomain = DeconstructDomain(Domain=div)  # -> Start, End
addition = Addition(A=dedomain.Start, B=dedomain.End)
division = Division(A=addition, B=2)
R = ClusterOutput(division)

# ==== cluster Cluster_2
T = ClusterInput()
trim = TrimTree(Tree=T, Depth=1)  # -> simplify(Tree)
D = ClusterInput()
lng = ListLength(List=trim)
dup = DuplicateData(Data=D, Number=lng, Order=True)  # -> simplify(graft(Data))
D_2 = ClusterOutput(dup)

# ==== cluster Cluster_3
ptcount = ClusterInput()
seed = ClusterInput()
ptcenter = ClusterInput()
ptcount_2 = Data(ptcount)
seed_2 = Data(seed)
ptcenter_2 = Data(ptcenter)
random = Random(Range=Domain(-2.5, 2.5), Number=ptcount_2, Seed=expr("x*3", seed_2))
random_2 = Random(Range=Domain(-2.5, 2.5), Number=ptcount_2, Seed=expr("X*2", seed_2))
random_3 = Random(Range=Domain(-2.5, 2.5), Number=ptcount_2, Seed=expr("X*1", seed_2))
Y = UnitY(Factor=random_2)
Z = UnitZ(Factor=random)
X = UnitX(Factor=random_3)
addition = Addition(A=X, B=Y)
addition_2 = Addition(A=addition, B=Z)
lng = ListLength(List=addition_2)  # -> expr("X-1", Length)
lng_2 = ListLength(List=addition_2)  # -> expr("X-1", Length)
lng_3 = ListLength(List=addition_2)  # -> expr("X-1", Length)
ma = MassAddition(Input=addition_2)  # -> Result, PartialResults
random_4 = Random(Range=lng, Number=ptcount_2, Seed=expr("X*13", 2))
random_5 = Random(Range=lng_2, Number=ptcount_2, Seed=expr("X*17", 2))
random_6 = Random(Range=lng_3, Number=ptcount_2, Seed=expr("X*23", 2))
int = Integer(random_4)
int_2 = Integer(random_5)
int_3 = Integer(random_6)
scale = ClusterInput()
item = ListItem(List=addition_2, Index=int, Wrap=True)
item_2 = ListItem(List=addition_2, Index=int_2, Wrap=True)
item_3 = ListItem(List=addition_2, Index=int_3, Wrap=True)
scale_2 = Data(scale)
addition_3 = Addition(A=item, B=item_2)
addition_4 = Addition(A=addition_3, B=item_3)
multiplication = Multiplication(A=addition_4, B=scale_2)
move = Move(Geometry=ptcenter_2, Motion=multiplication)  # -> Geometry, Transform
pt = Point(move.Geometry)
pt_2 = ClusterOutput(pt)

# ==== cluster Cluster_4
p_out = ClusterInput()
p_k_index = ClusterInput()
p_k_index_2 = Data(p_k_index)
p_out_2 = Data(p_out)
sort = SortList(Keys=p_k_index_2, ValuesA=p_out_2)  # -> Keys, ValuesA
reldif = RelativeDifferences(Values=sort.Keys)  # -> simplify(Differenced)
larger = LargerThan(FirstNumber=reldif, SecondNumber=0)  # -> LargerThan, OrEqualTo
lng = ListLength(List=larger.LargerThan)
series = Series(Start=0, Step=1, Count=lng)  # -> simplify(Series)
cull = CullPattern(List=series, CullPattern=larger.LargerThan)
lng_2 = ListLength(List=reldif)
merge = Merge(Data1=cull, Data2=lng_2)
item = ListItem(List=cull, Index=0, Wrap=True)
reldif_2 = RelativeDifferences(Values=merge)
replace = ReplaceItems(List=reldif_2, Item=item, Indices=0, Wrap=False)
partition = PartitionList(List=simplify(p_out_2), Size=simplify(replace))  # -> simplify(Chunks)
p_grouped = Data(partition)
p_grouped_2 = ClusterOutput(p_grouped)

# ==== cluster Down
Z = UnitZ(Factor=50)
G = ClusterInput()
rev = Reverse(Vector=Z)
move = Move(Geometry=G, Motion=rev)  # -> Geometry, Transform
G_2 = ClusterOutput(move.Geometry)
